# Grasshopper definition planar-truss.gh (Grasshopper 0.9.76)
# plug-ins: EleFront, GHRhinoBIM

# Portée
panel = Panel("37.2")
# Hauteur
# treillis
panel_2 = Panel("4")
# Largeur totale
panel_3 = Panel("3.7")
# Section diagonales
panel_4 = Panel("0.3")
# Section Membrures
# hautes et basses
panel_5 = Panel("0.3")
# Epaisseur totale
# tablier (dalle BA + traverses)
panel_6 = Panel("0.4")
# épaisseur
# culée
# hauteur
# culée
panel_7 = Panel("1")
addition = Addition(A=panel_3, B=panel_7)
# hauteur
# mur en retour
panel_8 = Panel("7")
# épaisseur
# mur en retour
panel_9 = Panel("0.35")
# largeur
# culée
panel_10 = Panel(addition)
panel_11 = Panel(panel_10)
# épaisseur
# dalle transition
# largeur
# dalle transition
panel_12 = Panel("0.25")
# longueur
# mur en retour
panel_13 = Panel("21")
Z = UnitZ(Factor="7")
X = UnitX(Factor=panel_7)
division = Division(A=panel_7, B="2")
subtraction = Subtraction(A=panel_9, B="0.1")
division_2 = Division(A=panel_7, B="2")
Y = UnitY(Factor=panel_9)
division_3 = Division(A=panel_7, B="2")
Z_2 = UnitZ(Factor=panel_8)
neg = Negative(Value=Z)
Y_2 = UnitY(Factor=subtraction)
addition_2 = Addition(A=division, B="7")
neg_2 = Negative(Value=X)
X_2 = UnitX(Factor=division_2)
Y_3 = UnitY(Factor=panel_9)
neg_3 = Negative(Value=Y)
neg_4 = Negative(Value=Z_2)
neg_5 = Negative(Value=Y_2)
Z_3 = UnitZ(Factor=addition_2)
X_3 = UnitX(Factor=division_3)
Y_4 = UnitY(Factor=panel_11)

# ----
# point origine
number_slider = Slider(0, range=0..50)
pt = ConstructPoint(XCoordinate=number_slider, YCoordinate=Slider(0, range=0..50), ZCoordinate=Slider(7, range=0..10))

# ----
# Point origine
panel_14 = Panel(pt)
# dalles transition
pt_2 = Point(pt)
Y_5 = UnitY(Factor=panel_10)
Z_4 = UnitZ(Factor=panel_12)
neg_6 = Negative(Value=Y_4)
# polyligne
# section culée
pt_3 = Point(pt)
# polyligne
# section mur en retour
move = Move(Geometry=pt_3, Motion=Y_3)  # -> Geometry, Transform
move_2 = Move(Geometry=move.Geometry, Motion=neg_4)  # -> Geometry, Transform
move_3 = Move(Geometry=move_2.Geometry, Motion=neg_3)  # -> Geometry, Transform
move_4 = Move(Geometry=pt_3, Motion=X_2)  # -> Geometry, Transform
move_5 = Move(Geometry=move_4.Geometry, Motion=neg)  # -> Geometry, Transform
move_6 = Move(Geometry=move_5.Geometry, Motion=neg_2)  # -> Geometry, Transform
move_7 = Move(Geometry=move_6.Geometry, Motion=Z_3)  # -> Geometry, Transform
move_8 = Move(Geometry=move_7.Geometry, Motion=X_3)  # -> Geometry, Transform
move_9 = Move(Geometry=pt_2, Motion=neg_5)  # -> Geometry, Transform
move_10 = Move(Geometry=move_9.Geometry, Motion=Y_5)  # -> Geometry, Transform
move_11 = Move(Geometry=move_10.Geometry, Motion=Z_4)  # -> Geometry, Transform
move_12 = Move(Geometry=move_11.Geometry, Motion=neg_6)  # -> Geometry, Transform

# ----
# point extrémité
X_4 = UnitX(Factor=panel)
move_13 = Move(Geometry=pt, Motion=X_4)  # -> Geometry, Transform

ln = Line(StartPoint=move_7.Geometry, EndPoint=move_8.Geometry)
ln_2 = Line(StartPoint=move_5.Geometry, EndPoint=move_6.Geometry)
ln_3 = Line(StartPoint=move_6.Geometry, EndPoint=move_7.Geometry)
ln_4 = Line(StartPoint=move_8.Geometry, EndPoint=pt_3)
ln_5 = Line(StartPoint=move_4.Geometry, EndPoint=move_5.Geometry)
ln_6 = Line(StartPoint=pt_3, EndPoint=move_4.Geometry)
ln_7 = Line(StartPoint=pt_3, EndPoint=move.Geometry)
ln_8 = Line(StartPoint=move.Geometry, EndPoint=move_2.Geometry)
ln_9 = Line(StartPoint=move_2.Geometry, EndPoint=move_3.Geometry)
ln_10 = Line(StartPoint=move_3.Geometry, EndPoint=pt_3)
ln_11 = Line(StartPoint=move_9.Geometry, EndPoint=move_10.Geometry)
ln_12 = Line(StartPoint=move_10.Geometry, EndPoint=move_11.Geometry)
ln_13 = Line(StartPoint=move_11.Geometry, EndPoint=move_12.Geometry)
ln_14 = Line(StartPoint=move_12.Geometry, EndPoint=move_9.Geometry)

# ----
# Membrure basse
ln_15 = Line(StartPoint=pt, EndPoint=move_13.Geometry)

# ----
# Nombre divisions membrure basse
# fonction hauteur diagonales (angle 60°)
panel_15 = Panel("""h : hauteur , c : coté

h = sqrt(3)/2 x c
2.60 = 0.866 x 3

c = 2 / sqrt (3) x h
3 = 1.732 x 2.60""")
sqrt = SquareRoot(Value="3")
len = Length(Curve=ln_15)
division_4 = Division(A="2", B=sqrt)
multiplication = Multiplication(A=panel_2, B=division_4)
round = Round(Number=multiplication)  # -> Nearest, Floor, Ceiling
division_5 = Division(A=len, B=round.Nearest)
round_2 = Round(Number=division_5)  # -> Nearest, Floor, Ceiling
multiplication_2 = Multiplication(A=round_2.Nearest, B="2")
divide = DivideCurve(Curve=ln_15, Count=multiplication_2, Kinks=False)  # -> Points, Tangents, Parameters

join = JoinCurves(Curves=[ln_7, ln_8, ln_9, ln_10], Preserve=False)
join_2 = JoinCurves(Curves=[ln_6, ln_5, ln_2, ln_3, ln, ln_4], Preserve=False)
join_3 = JoinCurves(Curves=[ln_11, ln_12, ln_13, ln_14], Preserve=False)
division_6 = Division(A=panel_7, B="2")

# ---- group: surface
Y_6 = UnitY(Factor=panel_3)
line = Line(ln_15)
move_14 = Move(Geometry=line, Motion=Y_6)  # -> Geometry, Transform
line_2 = Line(move_14.Geometry)
loft = Loft(Curves=[line_2, line], Options={Adjust=False, Closed=False, LoftEnds=0, LoftSimp=0, LoftType=0, Rebuild=10, Refit=0.01})

# ----
boundary = BoundarySurfaces(Edges=join_3)
division_7 = Division(A=panel_7, B="2")
X_5 = UnitX(Factor=division_6)
X_6 = UnitX(Factor=panel_13)
division_8 = Division(A=panel_7, B="2")

# ---- group: extrude both sides
# extrusion double, remplacée par + simple ...
panel_16 = Panel("x*-1")
eval = Evaluate(F=panel_16, x=panel_6)
Z_5 = UnitZ(Factor=[panel_6, eval])
division_9 = Division(A=Z_5, B="2")

# ----
Y_7 = UnitY(Factor=division_7)
neg_7 = Negative(Value=X_5)
neg_8 = Negative(Value=X_6)
move_15 = Move(Geometry=join, Motion=neg_7)  # -> Geometry, Transform
Y_8 = UnitY(Factor=division_8)
neg_9 = Negative(Value=Y_7)
move_16 = Move(Geometry=move_15.Geometry, Motion=neg_9)  # -> Geometry, Transform
# Culées
neg_10 = Negative(Value=Y_8)
boundary_2 = BoundarySurfaces(Edges=move_16.Geometry)
X_7 = UnitX(Factor=panel_13)
move_17 = Move(Geometry=join_2, Motion=neg_10)  # -> Geometry, Transform

# ----
# Tablier
Z_6 = UnitZ(Factor=panel_6)
extr = Extrude(Base=loft, Direction=Z_6)

Y_9 = UnitY(Factor=panel_10)
boundary_3 = BoundarySurfaces(Edges=move_17.Geometry)
neg_11 = Negative(Value=X_7)
subtraction_2 = Subtraction(A=panel_10, B=panel_9)

# ---- group: shift downwards
division_10 = Division(A=panel_5, B="2")
neg_12 = Negative(Value=division_10)
Z_7 = UnitZ(Factor=neg_12)
move_18 = Move(Geometry=extr, Motion=Z_7)  # -> Geometry, Transform

# ----
Y_10 = UnitY(Factor=subtraction_2)

# ---- group: Mur en retour 1
extr_2 = Extrude(Base=boundary_2, Direction=neg_11)

# ----
division_11 = Division(A=panel, B="2")

# ---- group: mur en retour 2
move_19 = Move(Geometry=extr_2, Motion=Y_10)  # -> Geometry, Transform

# ---- group: dalle transition 1
extr_3 = Extrude(Base=boundary, Direction=neg_8)

# ----
pt_4 = ConstructPoint(XCoordinate=division_11, YCoordinate=0, ZCoordinate=0)

# ---- group: Culée 1
extr_4 = Extrude(Base=boundary_3, Direction=Y_9)

# ----
yz = YZPlane(Origin=pt_4)
mirror = Mirror(Geometry=extr_4, Plane=yz)  # -> Geometry, Transform
X_8 = UnitX(Factor=panel)
yz_2 = YZPlane(Origin=Point(0, 0, 0))

# ---- group: Axes : membrure basse
geo = Geometry(ln_15)

# ---- group: Culée + 2 murs
join_4 = BrepJoin(Breps=[extr_4, extr_2, move_19.Geometry, extr_3])  # -> Breps, Closed

# ----
mirror_2 = Mirror(Geometry=join_4.Breps, Plane=yz_2)  # -> Geometry, Transform

# ---- group: Copie culee+mur+transition
move_20 = Move(Geometry=mirror_2.Geometry, Motion=X_8)  # -> Geometry, Transform

# ---- group: Profile - RhinoBIM
# Selects Standard from Database
standardid = SelectsStandard({"ANSI/ASTM": 0, "Chinese": 1, "DIN": 2, "Euro": 3, "India": 4, "Japan": 5, "Korea": 6, "Wood": 7, "SSMA": 8, "UK": 9, "Imported Standard": 10}, selected="Euro")

# Structure Properties
materialid = SelectsMaterial({"1023 Carbon (SS)": 0, "201 Annealed Stainless (SS)": 1, "AISI 1015 cold drawn (SS)": 2, "AISI 1035 (SS)": 3, "AISI 1045 cold drawn": 4, "AISI 316 (SS)": 5, "AISI 321 (SS)": 6, "AISI 347 (SS)": 7, "Alloy Steel (SS)": 8, "Cast Alloy Steel": 9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}, selected="1023 Carbon (SS)")
treatmentid = SelectsTreatment({"Untreated": 0, "Painted": 1, "Galvanized": 2, "Fireproof": 3}, selected="Galvanized")
# Optional Data: Alignment, rotation & material properties
role = SelectsRole({"Column": 0, "Beam": 1, "Member": 2, "Pile": 3, "Plate": 4}, selected="Member")
dbtreatments = ListsTreatments(Index=treatmentid)  # -> Treatment, TreatmentList
dbmaterials = ListsMaterials(Index=materialid)  # -> Material, MaterialList

# Profile Modifiers
X_9 = Slider(0, range=0..1)
Z_8 = Slider(0, range=0..1)
Y_11 = Slider(0, range=0..1)
alignment = SelectsAlignment({"Bottom left": 1, "Bottom center": 2, "Bottom right": 3, "Mid-depth left": 4, "Mid-depth center": 5, "Mid-depth right": 6, "Top left": 7, "Top center": 8, "Top right": 9}, selected="Mid-depth center")
rotation = Slider(0, range=0..6.283)
mirrored_profile = BooleanToggle(False)
vec = VectorXYZ(XComponent=X_9, YComponent=Y_11, ZComponent=Z_8)  # -> Vector, Length
unit = UnitVector(Vector=vec.Vector)

# ----
Y_12 = UnitY(Factor=panel_3)

# ---- group: Tablier
brep = Brep(move_18.Geometry)

# ---- group: Culee 2
brep_2 = Brep(mirror.Geometry)

# ---- group: Culee 1
brep_3 = Brep(extr_4)

# ----
# Membrure haute
Z_9 = UnitZ(Factor=panel_2)

# ----
# Diagonales
panel_17 = Panel("""False
True""")
panel_18 = Panel("""True
False""")
cull = CullPattern(List=divide.Points, CullPattern=panel_17)
cull_2 = CullPattern(List=divide.Points, CullPattern=panel_18)
move_21 = Move(Geometry=cull, Motion=Z_9)  # -> Geometry, Transform
weave = Weave(Pattern=[0, 1], Stream0=cull_2, Stream1=move_21.Geometry, NullGaps=False)
pline = PolyLine(Vertices=weave, Closed=False)
explode = Explode(Curve=pline, Recursive=True)  # -> Segments, Vertices

# ----
# Axes
pline_2 = PolyLine(Vertices=move_21.Geometry, Closed=False)

# ----
# Diagonales
panel_19 = Panel("2")
division_12 = Division(A=panel_4, B=panel_19)
pipe = Pipe(Curve=explode.Segments, Radius=division_12, Caps="2")

# ---- group: Axes : diagonales
geo_2 = Geometry(explode.Segments)

# ---- group: Axes : membrure haute
geo_3 = Geometry(pline_2)

# ----
geo_4 = Geometry([geo_3, geo_2, geo])

# ----
# Membrures Haute et Basse
panel_20 = Panel("2")

division_13 = Division(A=panel_5, B=panel_20)

pipe_2 = Pipe(Curve=[pline_2, ln_15], Radius=division_13, Caps="2")

# ----
# Sections
Y_13 = UnitY(Factor=panel_3)
move_22 = Move(Geometry=[pipe_2, pipe], Motion=Y_13)  # -> Geometry, Transform

# ---- group: OLD : treillis/pipe + tablier
join_5 = BrepJoin(Breps=[move_22.Geometry, pipe_2, pipe, move_18.Geometry])  # -> Breps, Closed

# ---- group: OLD : treillis + culée
join_6 = BrepJoin(Breps=[move_22.Geometry, pipe_2, pipe, move_18.Geometry, join_4.Breps, move_20.Geometry])  # -> Breps, Closed

# ---- group: Profile - RhinoBIM
# Available Catalogs for selected Standard
catalogid = Slider(0, range=0..10)

# Available Shape Types
# for selected Standard/Catalog
shapetypeid = Slider(26, range=0..30)

# Available Profile sizes for selected
# Standard/Catalog/Shape Type
profilesizeid = Slider(87, range=0..100)

# Selects Profile Size From RhinoBIM Database
dbstandards = GetsStandards(Index=standardid)  # -> Standard, StandardList
dbcatalogs = GetsCatalogs(Standard=dbstandards.Standard, Index=catalogid)  # -> Catalog, CatalogList
dbshapetype = GetsShapeType(Standard=dbstandards.Standard, Catalog=dbcatalogs.Catalog, Index=shapetypeid)  # -> ShapeType, TypeList
dbprofilesize = GetsProfileSizes(Standard=dbstandards.Standard, Catalog=dbcatalogs.Catalog, Type=dbshapetype.ShapeType, Index=profilesizeid, Sort=True)  # -> Size, SizeList
standard = Text(dbstandards.Standard)
catalog = Text(dbcatalogs.Catalog)
shape_type = Text(dbshapetype.ShapeType)
profile_size = Text(dbprofilesize.Size)

panel_21 = Panel(dbcatalogs.CatalogList)

panel_22 = Panel(dbprofilesize.SizeList)

panel_23 = Panel(dbshapetype.TypeList)

# ---- group: Structure Result
# Result Beam
beam = CreateBeam(
    Path=geo_4,
    Standard=standard,
    Catalog=catalog,
    Shape=shape_type,
    Size=profile_size,
    Treatment=dbtreatments.Treatment,
    Material=dbmaterials.Material,
    Role=role,
    Mirrored=mirrored_profile,
    Alignment=alignment,
    Rotation=rotation,
    UpVector=unit)

# ----
brep_4 = Brep(beam)
move_23 = Move(Geometry=brep_4, Motion=Y_12)  # -> Geometry, Transform

# ---- group: Treillis / profil
brep_5 = Brep([brep_4, move_23.Geometry])

# ----
brep_6 = Brep([brep_5, brep, brep_3, brep_2])

# ---- group: BAKE ! passerelle : treillis+tablier+culee
attributes = ObjectAttributes(Name="passerelle complete", Layer="3D_grasshopper_passerelle", Color=ColourSwatch(SwatchColor=RGB(64, 116, 178)))
bake = BakeObjects(Geometry=brep_6, Attributes=attributes, Bake=False)
