# Grasshopper definition rampe.gh (Grasshopper 0.9.76)
# plug-ins: EleFront

# ---- group: RAMPE
# Point origine
# Largeur
# Longueur
# Hauteur
# Epaisseur
panel = Panel("1.6")
panel_2 = Panel("0.20")
# Pente à respecter
# 
# 5 % = 0,50 mh / 10 ml * 100
# = 0,40 mh / 8 ml * 100
# = 0,25 mh / 5 ml * 100
panel_3 = Panel("8")
panel_4 = Panel("0.4")

# ----
division = Division(A=panel_4, B=panel_3)
multiplication = Multiplication(A=division, B="100")
Y = UnitY(Factor=panel)
X = UnitX(Factor=panel_3)

# ----
# Pente
panel_5 = Panel(multiplication)

Z = UnitZ(Factor=panel_4)

# ---- group: POINTS
pt = ConstructPoint(XCoordinate=Slider(0, range=0..1000), YCoordinate=Slider(0, range=0..1000), ZCoordinate=Slider(0, range=0..1000))
move = Move(Geometry=pt, Motion=Y)  # -> Geometry, Transform
move_2 = Move(Geometry=pt, Motion=X)  # -> Geometry, Transform
move_3 = Move(Geometry=move_2.Geometry, Motion=Z)  # -> Geometry, Transform

# ---- group: RAMPE (continued)
panel_6 = Panel(pt)

# ---- group: PALIER sommet rampe
# Longueur
panel_7 = Panel("1.50")
Y_2 = UnitY(Factor=panel)
X_2 = UnitX(Factor=panel_7)
move_4 = Move(Geometry=move_3.Geometry, Motion=X_2)  # -> Geometry, Transform
move_5 = Move(Geometry=move_4.Geometry, Motion=Y_2)  # -> Geometry, Transform
ln = Line(StartPoint=move_4.Geometry, EndPoint=move_5.Geometry)
ln_2 = Line(StartPoint=move_3.Geometry, EndPoint=move_4.Geometry)
swp1 = Sweep1(Rail=ln_2, Sections=ln, Miter=1)

# ---- group: SURFACE rampe
ln_3 = Line(StartPoint=pt, EndPoint=move.Geometry)
ln_4 = Line(StartPoint=pt, EndPoint=move_3.Geometry)
Z_2 = UnitZ(Factor=expr("-1*x", panel_2))
swp1_2 = Sweep1(Rail=ln_4, Sections=ln_3, Miter=1)

# ----
join = BrepJoin(Breps=[swp1_2, swp1])  # -> Breps, Closed

# ---- group: EXTRUSION rampe + palier sup
extr = Extrude(Base=join.Breps, Direction=Z_2)

# ---- group: BAKE rampe+ palier sup
attributes = ObjectAttributes(Name="rampe", Layer="3D_grasshopper_rampe", Color=ColourSwatch(SwatchColor=RGB(99, 51, 171)))
bake = BakeObjects(Geometry=extr, Attributes=attributes, Bake=False)
